vi "index.gviweb"   [G Web Development Software 22.3.0]
# Press “Analyse” and select a service report xml file
panel controls:
  "Analyse": bool  # Press the button “Analyse” and select a service report xml file.
  "Page 1": i32
  "Button": bool
  "Left Pan": i32
  "Explanations": bool
  "Left Pan_2": i32
panel indicators:
  "Specifications:": T1[]
  "URL-Grafik": string
  "SSR Commands": T2[]
  "SSR Commands_2": T3[]
  "PCB Temperature": T4[]
  "Left side pressure data": T5[]
  "Right side pressure data": T6[]
  "Microswitch": T7[]
  "Valves": T8[]
  "Motors": T9[]
  "Temperature sensors_Left": T10[]
  "Temperature sensors_right": T11[]
  "maximum left": f64[]
  "minimum left": f64[]
  "maximum right": f64[]
  "minimum right": f64[]
  "maximum": f64[]
  "minimum": f64[]
  "Angles": T12[]
  "maximum Angles": f64[]
  "minimum Angles": f64[]
  "Curve singel": cluster{"Element 1": f64[], "Element 2": f64[]}[]
  "Curve singel_right": cluster{"Element 1": f64[], "Element 2": f64[]}[]
  "File content:": string
  "maximum Pressure left": f64[]
  "minimum Pressure left": f64[]
  "maximum Pressure right": f64[]
  "minimum Pressure right": f64[]
  "Curve temp_PCB": cluster{"Element 1": f64[], "Element 2": f64[]}[]
  "Curve singel_right_2": cluster{"Element 1": f64[], "Element 2": f64[]}[]
  "Curve Pressure": cluster{"Element 1": f64[], "Element 2": f64[]}[]
  "Curve angles": cluster{"Element 1": f64[], "Element 2": f64[]}[]
types:
  T1 = cluster{"Information": string, "Details": string}
  T2 = cluster{"Timestamp": string, "R101": string, "R102": string, "R103": string, "R104": string, "R105": string, "R106": string, "R107": string, "R108": string, "R109": string, "R110": string, "R111": string, "R112": string, "R113": string, "R114": string, "R115": string, "R116": string, "R117": string, "R118": string}
  T3 = cluster{"Timestamp": string, "Charge Left": string, "Charge Right": string}
  T4 = cluster{"Timestamp": string, "CPU temperature": string, "IO temperature": string}
  T5 = cluster{"Timestamp": string, "Pressure_offset/ Left": string, "Pressure_offset_date/ Left": string, "Pressure_offset_time/ Left": string, "Pressure_phase/ Left": string, "P1_absolute": string, "P1_relative": string, "P3_I/O_pressure": string, "Pressure_in_pan/ Left": string}
  T6 = cluster{"Timestamp": string, "P2_absolute": string, "P2_relative": string, "Pressure_in_pan/ Right": string, "Right_pressure_offset": string, "Right_pressure_offset_date": string, "Right_pressure_offset_time": string, "Pressure_phase/ Right": string}
  T7 = cluster{"Timestamp": string, "S11": string, "S111": string, "S12": string, "S13": string, "Safety Chain Voltage": string}
  T8 = cluster{"Timestamp": string, "Right AZ Valve command request": string, "Y1": string, "Y2": string, "Y3": string, "Y4": string, "Y4 Close": string, "Y4 open": string, "Y5": string, "Y5 close": string, "Y5 open": string}
  T9 = cluster{"Timestamp": string, "Left Rahrbach locking": string, "Left Rahrbach unlocking": string, "M10(Cooling fan motor SSR)": string, "M2(Left Pan or lid)": string, "M4(Left Lid)": string, "M4-S1(Left Drain closed)": string, "M4-S2-S6(Left Lid locked switch)": string, "M4-S3(Left Drain open switch state)": string, "M6 (Right pan or lid)": string, "M8 (Right lid locked)": string, "M8-S1(Right drain closed)": string, "M8-S2-S6(Right lid locked switch state)": string, "M8-S3(Right drain open switch state)": string, "Right Rahrbach lock.": string, "Right Rahrbach unlock.": string}
  T10 = cluster{"Timestamp": string, "B101": string, "B102": string, "B103": string, "B104": string, "B105": string, "B106": string, "B201": string, "B301": string, "B302": string, "B303": string, "B304": string, "B305": string, "B306": string}
  T11 = cluster{"Timestamp": string, "B107": string, "B108": string, "B109": string, "B110": string, "B111": string, "B112": string, "B211": string, "B311": string, "B312": string, "B313": string, "B314": string, "B315": string, "B316": string}
  T12 = cluster{"Timestamp": string, "pt1": string, "pt1[ang]_lid": string, "pt1[ang]_pan": string, "pt2": string, "pt2[ang]_lid": string, "pt2[ang]_pan": string}
uses:
  WebApp::Library.jsli::AddIframe
  WebApp::Library.jsli::InsertURL
  FileTasks::Read File Text.gvi
  WebApp::General_Information.gviweb
  WebApp::Read_XML_Part.gviweb
  WebApp::Order_Sensors_infos.gviweb
  WebApp::Temperature sensors.gviweb
  WebApp::Temperature sensors_Right.gviweb
  WebApp::SSR Commands.gviweb
  WebApp::Pans charge.gviweb
  WebApp::Pressure_in_pan.gviweb
  WebApp::Pressure_in_pan_right.gviweb
  WebApp::Micoswitch.gviweb
  WebApp::Order_Sensors_infos_Part2.gviweb
  WebApp::Valves.gviweb
  WebApp::Motors.gviweb
  WebApp::Angles.gviweb
  WebApp::Graph_Temp.gviweb
  WebApp::Graph_Temp_right.gviweb
  WebApp::Graph_Temp_PCBs.gviweb
  WebApp::Graph_Pressure.gviweb
  WebApp::Graph_Angles.gviweb
diagram:
  w1 = "Init"  # State
  s1 = w1  # shift register
  s2 = string[] []  # shift register
  while {
    case (s1) {
      frame "Init", Default {
        w5 = "Wait For Interaction"  # State
        $"URL-Grafik" <- "Rational_Logo.png"
        Obtain JavaScript Reference(reference in=reference to "HTML Container") -> (javascript reference out=w6)
        call "AddIframe"(container=w6, error in=no error) -> (error out=w7)
        call "InsertURL"(url="WA24_Error_Snapshot.pdf", error in=w7) -> (error out=w8)
        for (N = 13) (iteration -> i1) {
          case (i1) {
            frame 20, Default {
              w2 = w8
            }
            frame 0 {
              Property Node(instance in=reference to "Temperature sensors_Left", "Value"=T10[] [], error in=w8) -> (error out=w9, instance out=w10)
              Close Reference(error in=w9, reference=w10) -> (error out=w11)
              Property Node(instance in=reference to "maximum left", "Value"=f64[] [], error in=w11) -> (error out=w12, instance out=w13)
              Close Reference(error in=w12, reference=w13) -> (error out=w14)
              Property Node(instance in=reference to "minimum left", "Value"=f64[] [], error in=w14) -> (error out=w15, instance out=w16)
              Close Reference(error in=w15, reference=w16) -> (error out=w2)
            }
            frame 1 {
              Property Node(instance in=reference to "Temperature sensors_right", "Value"=T10[] [], error in=w8) -> (error out=w17, instance out=w18)
              Close Reference(error in=w17, reference=w18) -> (error out=w19)
              Property Node(instance in=reference to "maximum right", "Value"=f64[] [], error in=w19) -> (error out=w20, instance out=w21)
              Close Reference(error in=w20, reference=w21) -> (error out=w22)
              Property Node(instance in=reference to "minimum right", "Value"=f64[] [], error in=w22) -> (error out=w23, instance out=w24)
              Close Reference(error in=w23, reference=w24) -> (error out=w2)
            }
            frame 2 {
              Property Node(instance in=reference to "PCB Temperature", "Value"=T4[] [], error in=w8) -> (error out=w25, instance out=w26)
              Close Reference(error in=w25, reference=w26) -> (error out=w27)
              Property Node(instance in=reference to "maximum", "Value"=f64[] [], error in=w27) -> (error out=w28, instance out=w29)
              Close Reference(error in=w28, reference=w29) -> (error out=w30)
              Property Node(instance in=reference to "minimum", "Value"=f64[] [], error in=w30) -> (error out=w31, instance out=w32)
              Close Reference(error in=w31, reference=w32) -> (error out=w2)
            }
            frame 5 {
              Property Node(instance in=reference to "Left side pressure data", "Value"=T5[] [], error in=w8) -> (error out=w33, instance out=w34)
              Close Reference(error in=w33, reference=w34) -> (error out=w35)
              Property Node(instance in=reference to "maximum Pressure left", "Value"=f64[] [], error in=w35) -> (error out=w36, instance out=w37)
              Close Reference(error in=w36, reference=w37) -> (error out=w38)
              Property Node(instance in=reference to "minimum Pressure left", "Value"=f64[] [], error in=w38) -> (error out=w39, instance out=w40)
              Close Reference(error in=w39, reference=w40) -> (error out=w2)
            }
            frame 6 {
              Property Node(instance in=reference to "Right side pressure data", "Value"=T6[] [], error in=w8) -> (error out=w41, instance out=w42)
              Close Reference(error in=w41, reference=w42) -> (error out=w43)
              Property Node(instance in=reference to "maximum Pressure right", "Value"=f64[] [], error in=w43) -> (error out=w44, instance out=w45)
              Close Reference(error in=w44, reference=w45) -> (error out=w46)
              Property Node(instance in=reference to "minimum Pressure right", "Value"=f64[] [], error in=w46) -> (error out=w47, instance out=w48)
              Close Reference(error in=w47, reference=w48) -> (error out=w2)
            }
            frame 10 {
              $"File content:" <- ""
              Property Node(instance in=reference to "Angles", "Value"=T12[] [], error in=w8) -> (error out=w49, instance out=w50)
              Close Reference(error in=w49, reference=w50) -> (error out=w51)
              Property Node(instance in=reference to "maximum Angles", "Value"=f64[] [], error in=w51) -> (error out=w52, instance out=w53)
              Close Reference(error in=w52, reference=w53) -> (error out=w54)
              Property Node(instance in=reference to "minimum Angles", "Value"=f64[] [], error in=w54) -> (error out=w55, instance out=w56)
              Close Reference(error in=w55, reference=w56) -> (error out=w2)
            }
            frame 7 {
              Property Node(instance in=reference to "Microswitch", "Value"=T7[] [], error in=w8) -> (error out=w57, instance out=w58)
              Close Reference(error in=w57, reference=w58) -> (error out=w2)
            }
            frame 8 {
              Property Node(instance in=reference to "Valves", "Value"=T8[] [], error in=w8) -> (error out=w59, instance out=w60)
              Close Reference(error in=w59, reference=w60) -> (error out=w2)
            }
            frame 9 {
              Property Node(instance in=reference to "Motors", "Value"=T9[] [], error in=w8) -> (error out=w61, instance out=w62)
              Close Reference(error in=w61, reference=w62) -> (error out=w2)
            }
            frame 3 {
              Property Node(instance in=reference to "SSR Commands_2", "Value"=T3[] [], error in=w8) -> (error out=w63, instance out=w64)
              Close Reference(error in=w63, reference=w64) -> (error out=w2)
            }
            frame 12 {
              Property Node(instance in=reference to "Curve singel_right", "Value"=cluster{"Element 1": f64[], "Element 2": f64[]}[] [], error in=w8) -> (error out=w65, instance out=w66)
              Close Reference(error in=w65, reference=w66) -> (error out=w2)
            }
            frame 13 {
              Property Node(instance in=reference to "Curve temp_PCB", "Value"=cluster{"Element 1": f64[], "Element 2": f64[]}[] [], error in=w8) -> (error out=w67, instance out=w68)
              Close Reference(error in=w67, reference=w68) -> (error out=w2)
            }
            frame 14 {
              Property Node(instance in=reference to "Curve Pressure", "Value"=cluster{"Element 1": f64[], "Element 2": f64[]}[] [], error in=w8) -> (error out=w69, instance out=w70)
              Close Reference(error in=w69, reference=w70) -> (error out=w2)
            }
            frame 15 {
              Property Node(instance in=reference to "Curve angles", "Value"=cluster{"Element 1": f64[], "Element 2": f64[]}[] [], error in=w8) -> (error out=w71, instance out=w72)
              Close Reference(error in=w71, reference=w72) -> (error out=w2)
            }
            frame 11 {
              Property Node(instance in=reference to "Curve singel", "Value"=cluster{"Element 1": f64[], "Element 2": f64[]}[] [], error in=w8) -> (error out=w73, instance out=w74)
              Close Reference(error in=w73, reference=w74) -> (error out=w2)
            }
            frame 4 {
              Property Node(instance in=reference to "SSR Commands", "Value"=T2[] [], error in=w8) -> (error out=w75, instance out=w76)
              Close Reference(error in=w75, reference=w76) -> (error out=w2)
            }
          }
        }
        $"Page 1" <- 0
        w3 = w5
        w4 = s2
      }
      frame "Read XML File" {
        call "Read File Text.gvi"(allowed file types=[".xml"], error in=no error) -> (file content=w77, file name=w78, error out=w79)
        Match Pattern(regular expression="ErrorSnapshots", string=w77) -> (match substring=w80)
        case (w80) {
          frame "False", Default {
            One Button Dialog(message="Please select an 'ErrorSnapshots' XML file !")
            w2 = w79
            w4 = string[] []
            w3 = "Init"
          }
          frame "ErrorSnapshots" {
            $"File content:" <- w77
            call "General_Information.gviweb"(File name=w78, Error Input=w79) -> (General information=w81, Device type=w82, Error Output=w83)
            case (w82) {
              frame "False", Default {
                w84 = "Please select an 'ErrorSnapshots' XML file for 2-S P Device !"
                One Button Dialog(message=w84)
                w3 = "Init"
                w2 = w83
                w4 = string[] []
              }
              frame "2-S P" {
                w85 = "Temperature sensors"  # State
                call "Read_XML_Part.gviweb"(Input XML=w77, Start XML Part="<Sensor>", End XML Part="</Sensor>", Error in=w83) -> (Output XML array=w4, Error out=w2)
                w3 = w85
              }
            }
            $"Specifications:" <- w81
          }
        }
      }
      frame "Temperature sensors" {
        call "Order_Sensors_infos.gviweb"(Input XML array=s2, Error Input=no error) -> (Temperature sensors Left=w86, Error Output=w87)
        call "Temperature sensors.gviweb"(Temperature sensors array=w86, Intput=w87) -> (Temperature sensors=w88, maximum left=w89, minimum left=w90, Output=w91)
        $"Temperature sensors_Left" <- w88
        w92 = "SSR Commands"  # State
        call "Temperature sensors_Right.gviweb"(Temperature sensors array=w86, Intput=w91) -> (Temperature sensors=w93, maximum right=w94, minimum right=w95, Output=w2)
        $"Temperature sensors_right" <- w93
        $"maximum right" <- w94
        $"minimum right" <- w95
        $"maximum left" <- w89
        $"minimum left" <- w90
        w3 = w92
        w4 = s2
      }
      frame "SSR Commands" {
        w96 = "Pans charge"  # State
        call "Order_Sensors_infos.gviweb"(Input XML array=s2, Error Input=no error) -> (SSR Commands=w97, Error Output=w98)
        call "SSR Commands.gviweb"(SSR Commands array=w97, Intput=w98) -> (SSR Commands=w99, Output=w2)
        $"SSR Commands" <- w99
        w3 = w96
        w4 = s2
      }
      frame "Pans charge" {
        w100 = "PCB Temperatures"  # State
        call "Order_Sensors_infos.gviweb"(Input XML array=s2, Error Input=no error) -> (Pans charge=w101, Error Output=w102)
        call "Pans charge.gviweb"(Pans charge array=w101, Intput=w102) -> (Pans charge=w103, Output=w2)
        $"SSR Commands_2" <- w103
        w3 = w100
        w4 = s2
      }
      frame "PCB Temperatures" {
        w104 = "Left side pressure data"  # State
        call "Order_Sensors_infos.gviweb"(Input XML array=s2, Error Input=no error) -> (PCB Temperatures=w105, Error Output=w106)
        call "Pans charge.gviweb"(Pans charge array=w105, Intput=w106) -> (Pans charge=w107, maximum=w108, minimum=w109, Output=w2)
        $"PCB Temperature" <- w107
        $maximum <- w108
        $minimum <- w109
        w3 = w104
        w4 = s2
      }
      frame "Left side pressure data" {
        call "Order_Sensors_infos.gviweb"(Input XML array=s2, Error Input=no error) -> (Error Output=w110, Left side pressure data=w111)
        call "Pressure_in_pan.gviweb"(Pressure_in_pan array=w111, Intput=w110) -> (Pressure_in_pan=w112, maximum Pressure left=w113, minimum Pressure left=w114, Output=w2)
        $"minimum Pressure left" <- w114
        w115 = "Right side pressure data"  # State
        $"Left side pressure data" <- w112
        $"maximum Pressure left" <- w113
        w3 = w115
        w4 = s2
      }
      frame "Right side pressure data" {
        w116 = "Microswitch"  # State
        call "Order_Sensors_infos.gviweb"(Input XML array=s2, Error Input=no error) -> (Right side pressure data=w117)
        call "Pressure_in_pan_right.gviweb"(Pressure_in_pan_right array=w117) -> (Pressure_in_pan_right=w118, maximum Pressure right=w119, minumum Pressure right=w120, Output=w2)
        $"Right side pressure data" <- w118
        $"maximum Pressure right" <- w119
        $"minimum Pressure right" <- w120
        w3 = w116
        w4 = s2
      }
      frame "Microswitch" {
        w121 = "Valves"  # State
        call "Order_Sensors_infos.gviweb"(Input XML array=s2, Error Input=no error) -> (Microswitch=w122, Error Output=w123)
        call "Micoswitch.gviweb"(Micoswitch array=w122, Intput=w123) -> (Microswitch=w124, Output=w2)
        $Microswitch <- w124
        w3 = w121
        w4 = s2
      }
      frame "Valves" {
        w125 = "Motors"  # State
        call "Order_Sensors_infos_Part2.gviweb"(Input XML array=s2, Error Input=no error) -> (Valves=w126, Error Output=w127)
        call "Valves.gviweb"(Valves array=w126, Intput=w127) -> (Valves=w128, Output=w2)
        $Valves <- w128
        w3 = w125
        w4 = s2
      }
      frame "Motors" {
        w129 = "Angles"  # State
        call "Order_Sensors_infos_Part2.gviweb"(Input XML array=s2, Error Input=no error) -> (Motors=w130, Error Output=w131)
        call "Motors.gviweb"(Motors array=w130, Intput=w131) -> (Motors=w132, Output=w2)
        $Motors <- w132
        w3 = w129
        w4 = s2
      }
      frame "Angles" {
        w133 = "Error graph"  # State
        call "Order_Sensors_infos_Part2.gviweb"(Input XML array=s2, Error Input=no error) -> (Angles=w134, Error Output=w135)
        call "Angles.gviweb"(Angles array=w134, Intput=w135) -> (Angles=w136, maximum Angles=w137, minimum Angles=w138, Output=w2)
        $Angles <- w136
        $"maximum Angles" <- w137
        $"minimum Angles" <- w138
        w3 = w133
        w4 = s2
      }
      frame "Error graph" {
        w139 = "Wait For Interaction"  # State
        call "Graph_Temp.gviweb"(Temperature sensors=$"Temperature sensors_Left", Input=no error) -> (Curve singel=w140, Output=w141)
        call "Graph_Temp_right.gviweb"(Temperature sensors_right=$"Temperature sensors_right", Input=w141) -> (Curve singel=w142, Output=w143)
        call "Graph_Temp_PCBs.gviweb"(PCB Temperature=$"PCB Temperature", Input=w143) -> (Curve singel=w144, Output=w145)
        call "Graph_Pressure.gviweb"(Left side pressure data=$"Left side pressure data", Right side pressure data=$"Right side pressure data", Input=w145) -> (Curve singel=w146, Output=w147)
        $"Curve Pressure" <- w146
        call "Graph_Angles.gviweb"(Angles=$Angles, Input=w147) -> (Curve singel=w148, Output=w2)
        $"Curve angles" <- w148
        $"Curve temp_PCB" <- w144
        $"Curve singel_right" <- w142
        $"Curve singel" <- w140
        w3 = w139
        w4 = s2
      }
      frame "Explanations" {
        $"Page 1" <- 11
        w149 = "Wait For Interaction"  # State
        call "Order_Sensors_infos_Part2.gviweb"(Input XML array=s2, Error Input=no error) -> (Motors=w150, Error Output=w151)
        call "Motors.gviweb"(Motors array=w150, Intput=w151) -> (Output=w2)
        w3 = w149
        w4 = s2
      }
      frame "Wait For Interaction" {
        event {
          on "Analyse" Value changed {
            w152 = "Read XML File"  # State
            w2 = no error
            w3 = w152
          }
          on "Explanations" Value changed {
            w153 = "Explanations"  # State
            w2 = default
            w3 = w153
          }
        }
        w4 = s2
      }
    }
    next s1 = w3
    next s2 = w4
    stop if FALSE
  }
